% Simulink design studies MRR_xi_H8.mldatx for model MRR_H8

study "Csillapítási tényező": 13 simulations
  combinatorial set (13 points):
    "Variable_1": Variable(Name=xi), values -0.25:0.125:1.25 (13 points)