% Simulink design studies MRR_K8_xi.mldatx for model MRR_K8

study "Csillapítási tényező": 14 simulations
  combinatorial set (14 points):
    "Variable_1": Variable(Name=xi), values -0.1:0.1:1.2 (14 points)